# Grasshopper definition SMpanelScriptV3 (1).gh (Grasshopper 1.0.7)
# plug-ins: Weaverbird

rectangle = Rectangle(Plane=PlaneXY(0, 0, 0), XSize=Domain(0, 30), YSize=Domain(0, 5), Radius=0)  # -> Rectangle, Length

# ---- group: Параметри сітки
number_slider = Slider(90, range=0..200)
sqgrid = Square(Plane=PlaneXY(0, 0, 0), Size=number_slider, ExtentX=Slider(7, range=0..25), ExtentY=Slider(12, range=0..25))  # -> Cells, Points

# ----
crv = Curve(rectangle.Rectangle)
area = Area(Geometry=crv)  # -> Area, Centroid
rotate = Rotate(Geometry=crv, Angle=1.570796327, Plane=area.Centroid)  # -> Geometry, Transform
pt = Point(sqgrid.Points)
pdecon = Deconstruct(Point=flatten(pt))  # -> XComponent, YComponent, ZComponent
vec2pt = Vector2Pt(PointA=area.Centroid, PointB=sqgrid.Points, Unitize=False)  # -> Vector, Length
lng = ListLength(List=flatten(sqgrid.Points))
runion = RegionUnion(Curves=flatten([rotate.Geometry, crv]))
sort = SortList(Keys=pdecon.XComponent)  # -> Keys, ValuesA
sort_2 = SortList(Keys=pdecon.YComponent)  # -> Keys, ValuesA
dom = ConstructDomain(DomainStart=0, DomainEnd=10)
range = Range(Domain=dom, Steps=expr("x-1", lng))

# ---- group: Рандом паттерна
jitter = Jitter(List=range, Jitter=1, Seed=Slider(45, range=0..100))  # -> Values, Indices

# ----
fillet = Fillet(Curve=runion, Radius=1)
shift = ShiftList(List=sort_2.Keys, Shift=-1, Wrap=True)
shift_2 = ShiftList(List=sort.Keys, Shift=-1, Wrap=True)
item = ListItem(List=sort_2.Keys, Index=0, Wrap=True)
item_2 = ListItem(List=sort.Keys, Index=0, Wrap=True)
division = Division(A=number_slider, B=2)
item_3 = ListItem(List=shift, Index=0, Wrap=True)
item_4 = ListItem(List=shift_2, Index=0, Wrap=True)
subtraction = Subtraction(A=item_2, B=division)
subtraction_2 = Subtraction(A=item, B=division)
addition = Addition(A=item_4, B=division)
addition_2 = Addition(A=item_3, B=division)
pt_2 = ConstructPoint(XCoordinate=subtraction, YCoordinate=subtraction_2, ZCoordinate=0)
pt_3 = ConstructPoint(XCoordinate=addition, YCoordinate=addition_2, ZCoordinate=0)
rec_2pt = Rectangle2Pt(Plane=PlaneXY(0, 0, 0), PointA=pt_3, PointB=pt_2, Radius=0)  # -> Rectangle, Length

# ---- group: Розмір панелі
panel = Panel(rec_2pt.Rectangle)

# ----
offset = Offset(Curve=rec_2pt.Rectangle, Distance=-2, Plane=PlaneXY(0, 0, 0), Corners=1)
offset_2 = Offset(Curve=rec_2pt.Rectangle, Distance=-6, Plane=PlaneXY(0, 0, 0), Corners=1)
crv_cp = CurveClosestPoint(Point=flatten(pt), Curve=offset_2)  # -> Point, Parameter, expr("x-39", Distance)
panel_2 = Panel(crv_cp.Distance)
larger = LargerThan(FirstNumber=panel_2, SecondNumber=0)  # -> LargerThan, OrEqualTo
int = Integer(larger.LargerThan)
multiplication = Multiplication(A=jitter.Values, B=int)
pt_4 = ConstructPoint(XCoordinate=flatten(pdecon.XComponent), YCoordinate=flatten(pdecon.YComponent), ZCoordinate=flatten(multiplication))
del = DelaunayMesh(Points=pt_4, Plane=PlaneXY(0, 0, 0))
division_2 = Division(A=multiplication, B=1)
sort_3 = SortList(Keys=division_2)  # -> Keys, ValuesA
wbcatmullclark = WeaverbirdsCatmullClarkSubdivision(MeshCurves=del, Level=2, SmoothNakedEdges=1)
shift_3 = ShiftList(List=sort_3.Keys, Shift=-1, Wrap=True)
item_5 = ListItem(List=shift_3, Index=0, Wrap=True)
dom_2 = ConstructDomain(DomainStart=Slider(4.69, range=0..8), DomainEnd=item_5)
range_2 = Range(Domain=dom_2, Steps=Slider(13, range=0..100))
Z = UnitZ(Factor=range_2)
xy = XYPlane(Origin=Z)
sec = MeshPlane(Mesh=wbcatmullclark, Plane=xy)
len = Length(Curve=sec)
division_3 = Division(A=len, B=Slider(13, range=0..20))
fillet_2 = Fillet(Curve=offset, Radius=2)
move = Move(Geometry=fillet, Motion=vec2pt.Vector)  # -> Geometry, Transform
fillet_3 = Fillet(Curve=offset_2, Radius=2)
reb = RebuildCurve(Curve=sec, Degree=3, Count=division_3, Tangents=False)
crv_2 = Curve(reb)

# ---- group: Порізка
merge = Merge(Data1=fillet_2, Data2=move.Geometry)

# ---- group: Гравіювання
merge_2 = Merge(Data1=fillet_3, Data2=crv_2)
